# Grasshopper definition surface_modification.gh (Grasshopper 0.9.76)

surface = Surface(reparameterize(<surface referenced from the Rhino model>))
number = Number(Slider(6, range=0..50))
surface_points = SurfacePoints(Surface=surface)  # -> Points, Weights, Greville, UCount, VCount
multiplication = Multiplication(A=number, B=3)
series = Series(Start=0, Step=0, Count=multiplication)
series_2 = Series(Start=0, Step=0, Count=180)
point = Point(surface_points.Points)  # disabled
numbers_to_points = NumbersToPoints(Numbers=series_2, Mask=4)
numbers_to_points_2 = NumbersToPoints(Numbers=series, Mask=4)
split_list = SplitList(List=surface_points.Points, Index=number)  # -> ListA, ListB
vector_xyz = VectorXYZ(XComponent=Slider(0, range=-5000..0), YComponent=-500, ZComponent=0)  # -> Vector, Length
num = Number([3, 13, 23, 33, 43, 53])
list_item = ListItem(List=surface_points.Weights, Index=num, Wrap=True)
panel = Panel(num)
move = Move(Geometry=numbers_to_points_2, Motion=vector_xyz.Vector)  # -> Geometry, Transform
multiplication_2 = Multiplication(A=move.Geometry, B=list_item)
replace_items = ReplaceItems(List=numbers_to_points, Item=multiplication_2, Indices=num, Wrap=False)
point_deform = PointDeform(Geometry=surface, Points=surface_points.Points, Motion=replace_items)
panel_2 = Panel(split_list.ListA)
multiplication_3 = Multiplication()
surface_2 = Surface(point_deform)
surface_points_2 = SurfacePoints(Surface=surface_2)  # -> Points, Weights, Greville, UCount, VCount
